# Dynamo graph Corridor Barrier Setout - SW.dyn (Dynamo 2.5.2.7915)
# packages: Civil3DToolkit 1.1.19

# group: Usage metric collection
code_block = CodeBlock { "Corridor Barrier Setout"; "0.1.0"; }
usageMetrics = Custom[UsageMetrics](scriptName=code_block.out0, scriptVersion=code_block.out1)  # Tracks run information an uploads to Power BI Database

# group: Get Corridor Feature Lines
corridor_name = CorridorNameDropDown("Pokeno Road 4Lane")  # graph input
corridor_barrier_code = StringInput("Barrier")  # graph input
corridorFeatureLinesByCode = Custom[CorridorFeatureLinesByCode](corridor=corridor_name, code=corridor_barrier_code)  # frozen; Returns all corridor feature lines for a given code

polyCurve = Autodesk.Civil.DynamoNodes.CorridorFeatureLine.PolyCurve(corridorFeatureLine=corridorFeatureLinesByCode.CorridorFeatureLine)
start_terminal_offset = DoubleSlider(15.5, range=0..500 step 1)  # graph input

# group: Set barrier draw layer
barrier_draw_layer = StringInput("Barrier")  # graph input

code_block_2 = CodeBlock(layer=barrier_draw_layer) { layer; }

# group: Polyline set out start terminal
post_block_name = StringInput("TL3_Terminal")  # graph input
post_rotation_angle = DoubleInput(0)  # graph input
placeBlocksAlongPolycurve = Custom[PlaceBlocksAlongPolycurve](polycurve=polyCurve, station=start_terminal_offset, blockName=post_block_name, blockRotationAngle=post_rotation_angle, layer=code_block_2)

length = Curve.Length(curve=polyCurve)
end_terminal_offset = DoubleSlider(15.5, range=0..500 step 1)  # graph input
sub = length - end_terminal_offset
post_spacing = DoubleSlider(2, range=0..500 step 1)  # graph input

# group: Polyline set out posts
range = Range(start=start_terminal_offset, end=sub, step=post_spacing)
post_block_name_2 = StringInput("TL3_Post")  # graph input
post_rotation_angle_2 = DoubleInput(0)  # graph input

sub_2 = sub - start_terminal_offset
# note: Equalise start and end posts
mod = sub_2 % post_spacing
code_block_3 = CodeBlock(a=range, b=mod) { a; b; c=a+b/2; }

# group (continued): Polyline set out posts
placeBlocksAlongPolycurve_2 = Custom[PlaceBlocksAlongPolycurve](polycurve=polyCurve, station=code_block_3.c, blockName=post_block_name_2, blockRotationAngle=post_rotation_angle_2, layer=code_block_2)

# group: Polyline set out end terminal
post_block_name_3 = StringInput("TL3_Terminal")  # graph input
post_rotation_angle_3 = DoubleInput(180)  # graph input
placeBlocksAlongPolycurve_3 = Custom[PlaceBlocksAlongPolycurve](polycurve=polyCurve, station=sub, blockName=post_block_name_3, blockRotationAngle=post_rotation_angle_3, layer=code_block_2)

# group: Get lists of terminal and post objects
join = List.Join()  # unwired: list0, list1, list2
code_block_4 = CodeBlock(start_terminal=placeBlocksAlongPolycurve.BlockReference) { start_terminal; }
code_block_5 = CodeBlock { 2; }
flatten = List.Flatten(list=code_block_4, amt=code_block_5)
code_block_6 = CodeBlock { 1; }
chop = List.Chop(list=flatten, lengths=code_block_6)
code_block_7 = CodeBlock(posts=placeBlocksAlongPolycurve_2.BlockReference) { posts; }
code_block_8 = CodeBlock { 1; }
flatten_2 = List.Flatten(list=code_block_7, amt=code_block_8)
code_block_9 = CodeBlock(end_terminal=placeBlocksAlongPolycurve_3.BlockReference) { end_terminal; }
code_block_10 = CodeBlock { 2; }
flatten_3 = List.Flatten(list=code_block_9, amt=code_block_10)
code_block_11 = CodeBlock { 1; }
chop_2 = List.Chop(list=flatten_3, lengths=code_block_11)
combine = List.Combine(comb=join, list1=chop, list2=flatten_2, list3=chop_2)

# group: Place Barrier Elements
post_block_name_4 = StringInput("Wire_Rope_Barrier")  # graph input
placeBarrierBlocks = Custom[PlaceBarrierBlocks](blockReferencesToJoin=combine, blockName=post_block_name_4, drawLayer=barrier_draw_layer)

watch = Watch(code_block_3.c)
watch_2 = Watch(range)
addNewTypes = Autodesk.AutoCAD.DynamoNodes.DocumentExtensions.AddNewTypes()
objects_types = AcObjectTypes("FeatureLine")
current = Autodesk.AutoCAD.DynamoNodes.Document.Current()
modelSpace = Autodesk.AutoCAD.DynamoNodes.Document.ModelSpace(document=current)
all_objects_of_type = AcObjectsOfType(type=objects_types, block=modelSpace)
name = Autodesk.Civil.DynamoNodes.CivilObject.Name(civilObject=all_objects_of_type)
code_block_12 = CodeBlock { ""; }
eq = name == code_block_12
filterByBoolMask = List.FilterByBoolMask(list=all_objects_of_type, mask=eq)
filterByBoolMask_2 = List.FilterByBoolMask(list=name, mask=eq)
code_block_13 = CodeBlock(feature_lines=filterByBoolMask.out, feature_line_names=filterByBoolMask_2.out) { feature_lines; feature_line_names; }
watch_3 = Watch(code_block_13.feature_lines)
watch_4 = Watch(code_block_13.feature_line_names)
